vi "RiskReduction2.gvi"   [LabVIEW NXG 2.0.0]
panel controls:
  "Numeric": f64
  "Numeric_3": f64
panel indicators:
  "Numeric_2": f64
  "Numeric_4": f64
  "Numeric_5": i32
diagram:
  for (N = 5) {
    Add(0, 0) -> w1
    $Numeric_5 <- w1
  }
  Add($Numeric, 5) -> w2
  Multiply(w2, 2) -> w3
  $Numeric_2 <- w3
  Subtract(x=$Numeric_3, y=2) -> w4
  $Numeric_4 <- w4
